# Grasshopper definition DTCC Parser.gh (Grasshopper 1.0.7)
# Copyright: SS

file_path = FilePath("D:\AoA_Energy\Builder_output\CityModel.json")
ghpython_script = GhPythonScript(CityModel=file_path, run=Toggle(False))  # -> out, buildings
# ---------- ghpython_script: Python ----------
import rhinoscriptsyntax as rs
import ghpythonlib.treehelpers as th
import json
import Rhino as rh
if _run:
    with open(CityModel) as file:
        data = json.load(file)
    buildings = []
    for building in data['Buildings']:
        points = []
        z = building['GroundHeight']
        height = building['Height']
        for point in building['Footprint']:
            x = point['x']
            y = point['y']
            points.append(rs.AddPoint(x,y,z))
    
        polyline = rs.AddPolyline(points+[points[0]])
        path = rs.AddLine([0,0,0], [0,0,height])
        extrusion = rs.ExtrudeCurve(polyline,path)
        brep = rs.CapPlanarHoles(extrusion)
        buildings.append(extrusion)


buildings = th.list_to_tree(buildings)
# ---------- end ghpython_script ----------
